# Grasshopper definition 150404 Box cut and fold lines generator.gh (Grasshopper 0.9.14)
# plug-ins: LunchBox

# ---- group: Parameters
thickness_of_material = Slider(2.6, range=0.1..10)
plooitolerantie = Slider(0.1, range=0.1..10)
height_box = Slider(95, range=5..100)
width_box = Slider(372, range=40..1540)
depth_box = Slider(212, range=4..740)

# ----
bakebutton = Button()
neg = Negative(Value=height_box)
pt = PointXYZ(XComponent=neg, YComponent=depth_box, ZComponent=0, System=PlaneXY(0, 0, 0))
multiplication = Multiplication(A=width_box, B="10")
neg_2 = Negative(Value=height_box)
addition = Addition(A=depth_box, B=height_box)
pt_2 = Point(pt)
X = UnitX(Factor=width_box)
X_2 = UnitX(Factor=Slider(0, range=0..100))
Y = UnitY(Factor=depth_box)
Y_2 = UnitY(Factor=neg_2)
Y_3 = UnitY(Factor=addition)
zeropoint = Point(X_2)
width = Point(X)
pt_3 = Point(Y_2)
eval = Evaluate(F="((2*depth)+(height))-thickness", depth=depth_box, height=height_box, thickness=thickness_of_material)
Y_4 = UnitY(Factor=eval)
schuinte = Slider(10, range=0..10)
division = Division(A=width_box, B="2")
addition_2 = Addition(A=height_box, B=plooitolerantie)
division_2 = Division(A=depth_box, B="2")
X_3 = UnitX(Factor=division)
division_3 = Division(A=depth_box, B="4")
addition_3 = Addition(A=height_box, B=plooitolerantie)
addition_4 = Addition(A=height_box, B=plooitolerantie)
multiplication_2 = Multiplication(A=addition_2, B="2")
Y_5 = UnitY(Factor=division_2)
yz = YZPlane(Origin=X_3)
neg_3 = Negative(Value=division_3)
neg_4 = Negative(Value=addition_3)
neg_5 = Negative(Value=addition_4)
neg_6 = Negative(Value=schuinte)
division_4 = Division(A=height_box, B="2")
neg_7 = Negative(Value=multiplication_2)
ln = Line(StartPoint=zeropoint, EndPoint=width)
division_5 = Division(A=width_box, B="2")
xz = XZPlane(Origin=Y_5)
mirror = Mirror(Geometry=pt_3, Plane=xz)  # -> Geometry, Transform
ln_2 = Line(StartPoint=pt_3, EndPoint=mirror.Geometry)
pcomp = Decompose(Point=mirror.Geometry, System=PlaneXY(0, 0, 0))  # -> XComponent, YComponent, ZComponent
addition_5 = Addition(A=width_box, B=depth_box)
move = Move(Geometry=ln, Motion=[Y, Y_3, Y_4])  # -> Geometry, Transform
X_4 = UnitX(Factor=neg_4)
pt_4 = PointXYZ(XComponent=neg_7, YComponent=depth_box, ZComponent=0, System=PlaneXY(0, 0, 0))
pt_5 = PointXYZ(XComponent=neg_7, YComponent=schuinte, ZComponent=0, System=PlaneXY(0, 0, 0))
pt_6 = PointXYZ(XComponent=neg_3, YComponent=neg_5, ZComponent=0, System=PlaneXY(0, 0, 0))
pt_7 = PointXYZ(XComponent=neg_3, YComponent=neg_6, ZComponent=0, System=PlaneXY(0, 0, 0))
mirror_2 = Mirror(Geometry=pt_7, Plane=xz)  # -> Geometry, Transform
mirror_3 = Mirror(Geometry=pt_6, Plane=xz)  # -> Geometry, Transform
Y_6 = UnitY(Factor=depth_box)
multiplication_3 = Multiplication(A=thickness_of_material, B="2")
pt_8 = PointXYZ(XComponent=division_5, YComponent=neg_5, ZComponent=0, System=PlaneXY(0, 0, 0))
division_6 = Division(A=addition_5, B="50")
pt_9 = PointXYZ(XComponent=multiplication_3, YComponent=pcomp.YComponent, ZComponent=0, System=PlaneXY(0, 0, 0))
pcomp_2 = Decompose(Point=pt_9, System=PlaneXY(0, 0, 0))  # -> XComponent, YComponent, ZComponent
pcomp_3 = Decompose(Point=pt_9, System=PlaneXY(0, 0, 0))  # -> XComponent, YComponent, ZComponent
subtraction = Subtraction(A=pcomp_2.XComponent, B=division_4)
addition_6 = Addition(A=pcomp_2.YComponent, B=schuinte)
pcomp_4 = Decompose(Point=pt_9, System=PlaneXY(0, 0, 0))  # -> XComponent, YComponent, ZComponent
pt_10 = PointXYZ(XComponent=pcomp_3.XComponent, YComponent=Y_4, ZComponent=0, System=PlaneXY(0, 0, 0))
pt_11 = PointXYZ(XComponent=subtraction, YComponent=addition_6, ZComponent=0, System=PlaneXY(0, 0, 0))
addition_7 = Addition(A=pcomp_4.XComponent, B=schuinte)
ln_3 = Line(StartPoint=pt_9, EndPoint=pt_10)
pt_12 = PointXYZ(XComponent=subtraction, YComponent=Y_4, ZComponent=0, System=PlaneXY(0, 0, 0))
pt_13 = PointXYZ(XComponent=pcomp_4.XComponent, YComponent=Y_4, ZComponent=0, System=PlaneXY(0, 0, 0))
int = Integer(division_6)
addition_8 = Addition(A=eval, B=division_4)
division_7 = Division(A=width_box, B="2")
pt_14 = PointXYZ(XComponent=addition_7, YComponent=addition_8, ZComponent=0, System=PlaneXY(0, 0, 0))
pt_15 = PointXYZ(XComponent=division_7, YComponent=addition_8, ZComponent=0, System=PlaneXY(0, 0, 0))

pt_16 = Point(pt_4)
pt_17 = Point(pt_5)
pt_18 = Point(mirror_3.Geometry)
pt_19 = Point(mirror_2.Geometry)
pt_20 = Point(pt_11)
pt_21 = Point(X_4)
pt_22 = Point(pt_12)
pt_23 = Point(pt_7)
pt_24 = Point(pt_6)
pt_25 = Point(pt_9)
pt_26 = Point(Y_6)
pt_27 = Point(pt_13)
pt_28 = Point(zeropoint)
pt_29 = Point(pt_14)
pt_30 = Point(pt_15)
pt_31 = Point(pt_8)
merge = Merge(
    Data1=pt_30,
    Data2=pt_29,
    Data3=pt_27,
    Data4=pt_22,
    Data5=pt_20,
    Data6=pt_25,
    Data7=pt_18,
    Data8=pt_19,
    Data9=pt_26,
    Data10=pt_16,
    Data11=pt_17,
    Data12=pt_21,
    Data13=pt_28,
    Data14=pt_23,
    Data15=pt_24,
    Data16=pt_31)
pline = PolyLine(Vertices=merge, Closed=False)
division_8 = Division(A=width_box, B="2")
X_5 = UnitX(Factor=division_8)
yz_2 = YZPlane(Origin=X_5)
mirror_4 = Mirror(Geometry=pline, Plane=yz_2)  # -> Geometry, Transform
join = JoinCurves(Curves=[mirror_4.Geometry, pline], Preserve=False)

ln_4 = Line(StartPoint=pt_2, EndPoint=pt_21)
mirror_5 = Mirror(Geometry=[ln_2, ln_4, ln_3], Plane=yz)  # -> Geometry, Transform
dash = DashPattern(Curve=[ln, move.Geometry, ln_2, ln_4, mirror_5.Geometry, ln_3], Pattern=int)  # -> Dashes, Gaps
swatch = ColourSwatch(SwatchColor=RGB(0, 0, 0))
folding_lines = Curve(dash.Dashes)
swatch_2 = ColourSwatch(SwatchColor=RGB(255, 0, 0))
outline = Curve(join)
preview = CustomPreview(Geometry=outline, Shader=swatch)
preview_2 = CustomPreview(Geometry=folding_lines, Shader=swatch_2)
bake = ObjectBake(
    BakeToggle=bakebutton,
    GeometryObjects=folding_lines,
    Layer="Folding lines",
    ObjectName="GH_Obj",
    ObjectColor=swatch_2,
    LayerColor=swatch_2)
bake_2 = ObjectBake(
    BakeToggle=bakebutton,
    GeometryObjects=outline,
    Layer="Contour",
    ObjectName="GH_Obj",
    ObjectColor=swatch,
    LayerColor=swatch)
