# Grasshopper definition 150406 Box cut and fold lines generator.gh (Grasshopper 0.9.14)
# plug-ins: LunchBox

# ---- group: Parameters
plooitolerantie = Slider(0.1, range=0.1..10)
thickness_of_material = Slider(2.5, range=0.1..10)
height_box = Slider(62, range=5..100)
width_box = Slider(218, range=40..1540)
depth_box = Slider(142, range=4..740)
bakebutton = Button()

# ----
eval = Evaluate(F="y-(2*x)", x=thickness_of_material, y=depth_box)
eval_2 = Evaluate(F="y-(2*x)", x=thickness_of_material, y=width_box)
X = UnitX(Factor="0")
X_2 = UnitX(Factor=eval_2)
Y = UnitY(Factor=eval)
eval_3 = Evaluate(F="((2*depth)+(height))-thickness", depth=eval, height=height_box, thickness=thickness_of_material)
width = Point(X_2)
zeropoint = Point(X)
Y_2 = UnitY(Factor=eval_3)
schuinte = Slider(4, range=0..10)
schuinte_2 = Slider(10, range=0..10)
division = Division(A=height_box, B="2")
division_2 = Division(A=eval, B="2")
division_3 = Division(A=eval, B="2")
eval_4 = Evaluate(F="x/2", x=eval)
eval_5 = Evaluate(F="x/2", x=eval)
addition = Addition(A=height_box, B=plooitolerantie)
subtraction = Subtraction(A=division_2, B="5")
subtraction_2 = Subtraction(A=division_3, B="5")
addition_2 = Addition(A=height_box, B=plooitolerantie)
addition_3 = Addition(A=height_box, B=plooitolerantie)
Y_3 = UnitY(Factor=eval_4)
Y_4 = UnitY(Factor=eval_5)
neg = Negative(Value=subtraction)
neg_2 = Negative(Value=schuinte_2)
neg_3 = Negative(Value=subtraction_2)
eval_6 = Evaluate(F="(x*3)", x=thickness_of_material)
neg_4 = Negative(Value=addition)
addition_4 = Addition(A=height_box, B=plooitolerantie)
eval_7 = Evaluate(F="(x/2)-((y/3)/2)", x=eval, y=eval)
division_4 = Division(A=eval_2, B="2")
neg_5 = Negative(Value=addition_2)
neg_6 = Negative(Value=addition_3)
eval_8 = Evaluate(F="x-(y*3)", x=neg_6, y=thickness_of_material)
eval_9 = Evaluate(F="-((x-y)-z)", x=height_box, y=thickness_of_material, z=eval_8)
eval_10 = Evaluate(F="(2*x)", x=thickness_of_material)
subtraction_3 = Subtraction(A=eval, B=schuinte)
eval_11 = Evaluate(F="y-(x*1.5)", x=thickness_of_material, y=eval_9)
xz = XZPlane(Origin=Y_3)
xz_2 = XZPlane(Origin=Y_4)
addition_5 = Addition(A=eval_3, B=division)
addition_6 = Addition(A=eval, B=addition_4)
Y_5 = UnitY(Factor=addition_6)
addition_7 = Addition(A=eval, B=Slider(3.8, range=0.1..5))
division_5 = Division(A=eval_2, B="2")
division_6 = Division(A=eval_2, B="2")
X_3 = UnitX(Factor=neg_6)
pt = PointXYZ(XComponent=neg, YComponent=neg_2, ZComponent=0, System=PlaneXY(0, 0, 0))
pt_2 = PointXYZ(XComponent=neg_3, YComponent=neg_4, ZComponent=0, System=PlaneXY(0, 0, 0))
pt_3 = PointXYZ(XComponent=division_4, YComponent=neg_5, ZComponent=0, System=PlaneXY(0, 0, 0))
pt_4 = PointXYZ(XComponent=eval_8, YComponent=schuinte, ZComponent=0, System=PlaneXY(0, 0, 0))
X_4 = UnitX(Factor=eval_10)
pt_5 = PointXYZ(XComponent=eval_9, YComponent=schuinte, ZComponent=0, System=PlaneXY(0, 0, 0))
pt_6 = PointXYZ(XComponent=eval_9, YComponent=eval_7, ZComponent=0, System=PlaneXY(0, 0, 0))
pt_7 = PointXYZ(XComponent=eval_11, YComponent=eval_7, ZComponent=0, System=PlaneXY(0, 0, 0))
mirror = Mirror(Geometry=pt_6, Plane=xz)  # -> Geometry, Transform
mirror_2 = Mirror(Geometry=pt_7, Plane=xz_2)  # -> Geometry, Transform
pt_8 = PointXYZ(XComponent=eval_9, YComponent=subtraction_3, ZComponent=0, System=PlaneXY(0, 0, 0))
pt_9 = PointXYZ(XComponent=eval_8, YComponent=subtraction_3, ZComponent=0, System=PlaneXY(0, 0, 0))
pt_10 = PointXYZ(XComponent=neg_6, YComponent=eval, ZComponent=0, System=PlaneXY(0, 0, 0))
pt_11 = PointXYZ(XComponent=thickness_of_material, YComponent=eval, ZComponent=0, System=PlaneXY(0, 0, 0))
pt_12 = PointXYZ(XComponent=eval_6, YComponent=addition_6, ZComponent=0, System=PlaneXY(0, 0, 0))
pcomp = Decompose(Point=pt_12, System=PlaneXY(0, 0, 0))  # -> XComponent, YComponent, ZComponent
pcomp_2 = Decompose(Point=pt_12, System=PlaneXY(0, 0, 0))  # -> XComponent, YComponent, ZComponent
subtraction_4 = Subtraction(A=pcomp.XComponent, B=division)
addition_8 = Addition(A=pcomp.YComponent, B=schuinte_2)
addition_9 = Addition(A=pcomp_2.XComponent, B=schuinte_2)
pcomp_3 = Decompose(Point=pt_12, System=PlaneXY(0, 0, 0))  # -> XComponent, YComponent, ZComponent
pt_13 = PointXYZ(XComponent=subtraction_4, YComponent=Y_2, ZComponent=0, System=PlaneXY(0, 0, 0))
pt_14 = PointXYZ(XComponent=subtraction_4, YComponent=addition_8, ZComponent=0, System=PlaneXY(0, 0, 0))
pt_15 = PointXYZ(XComponent=neg, YComponent=addition_7, ZComponent=0, System=PlaneXY(0, 0, 0))
pt_16 = PointXYZ(XComponent=thickness_of_material, YComponent=addition_6, ZComponent=0, System=PlaneXY(0, 0, 0))
pt_17 = PointXYZ(XComponent=neg, YComponent=addition_6, ZComponent=0, System=PlaneXY(0, 0, 0))
division_7 = Division(A=height_box, B="2")
X_5 = UnitX(Factor=division_5)
pt_18 = PointXYZ(XComponent=pcomp_2.XComponent, YComponent=Y_2, ZComponent=0, System=PlaneXY(0, 0, 0))
pt_19 = PointXYZ(XComponent=addition_9, YComponent=addition_5, ZComponent=0, System=PlaneXY(0, 0, 0))
pt_20 = PointXYZ(XComponent=division_6, YComponent=addition_5, ZComponent=0, System=PlaneXY(0, 0, 0))
pt_21 = PointXYZ(XComponent=eval_10, YComponent=neg_4, ZComponent=0, System=PlaneXY(0, 0, 0))
yz = YZPlane(Origin=X_5)
pt_22 = PointXYZ(XComponent=pcomp_3.XComponent, YComponent=Y_2, ZComponent=0, System=PlaneXY(0, 0, 0))
ln = Line(StartPoint=pt_4, EndPoint=pt_9)
ln_2 = Line(StartPoint=pt_11, EndPoint=pt_16)
pt_23 = Point(pt_16)

pt_24 = Point(mirror_2.Geometry)
pt_25 = Point(pt_7)
pt_26 = Point(pt_8)
pt_27 = Point(pt_6)
pt_28 = Point(pt_5)
pt_29 = Point(mirror.Geometry)
pt_30 = Point(pt_4)
pt_31 = Point(pt_9)
pt_32 = Point(pt_17)
pt_33 = Point(pt_15)
pt_34 = Point(pt_14)
pt_35 = Point(pt_10)
pt_36 = Point(X_3)
pt_37 = Point(pt_13)
pt_38 = Point(pt)
pt_39 = Point(pt_2)
pt_40 = Point(pt_11)
pt_41 = Point(X_4)
pt_42 = Point(pt_18)
pt_43 = Point(pt_12)
pt_44 = Point(pt_19)
pt_45 = Point(pt_20)
pt_46 = Point(pt_3)
merge = Merge(
    Data1=pt_45,
    Data2=pt_44,
    Data3=pt_42,
    Data4=pt_37,
    Data5=pt_34,
    Data6=pt_43,
    Data7=pt_23,
    Data8=pt_32,
    Data9=pt_33,
    Data10=pt_40,
    Data11=pt_35,
    Data12=pt_31,
    Data13=pt_26,
    Data14=pt_29,
    Data15=pt_24,
    Data16=pt_25,
    Data17=pt_27,
    Data18=pt_28,
    Data19=pt_30,
    Data20=pt_36,
    Data21=pt_41,
    Data22=pt_38,
    Data23=pt_39,
    Data24=pt_46)
pline = PolyLine(Vertices=merge, Closed=False)
division_8 = Division(A=eval_2, B="2")
X_6 = UnitX(Factor=division_8)
yz_2 = YZPlane(Origin=X_6)
mirror_3 = Mirror(Geometry=pline, Plane=yz_2)  # -> Geometry, Transform
join = JoinCurves(Curves=[mirror_3.Geometry, pline], Preserve=False)

cir = Circle(Plane=pt_42, Radius=division_7)

ln_3 = Line(StartPoint=pt_35, EndPoint=pt_36)
ln_4 = Line(StartPoint=zeropoint, EndPoint=Y)
ln_5 = Line(StartPoint=pt_21, EndPoint=X_4)
ln_6 = Line(StartPoint=pt_12, EndPoint=pt_22)
ln_7 = Line(StartPoint=zeropoint, EndPoint=width)
move = Move(Geometry=ln_7, Motion=[Y, Y_5, Y_2])  # -> Geometry, Transform
mirror_4 = Mirror(Geometry=[ln_4, ln_3, ln_6, ln, ln_5, ln_2], Plane=yz)  # -> Geometry, Transform

eval_12 = Evaluate(F="(x/2)-((y/3)/2)", x=eval, y=eval)

division_9 = Division(A=eval, B="2")
division_10 = Division(A=eval, B="3")
division_11 = Division(A=division_10, B="2")
addition_10 = Addition(A=division_9, B=division_11)
Y_6 = UnitY(Factor=eval_12)
multiplication = Multiplication(A=thickness_of_material, B="3")
subtraction_5 = Subtraction(A=multiplication, B="0.2")
pt_47 = PointXYZ(XComponent=subtraction_5, YComponent=addition_10, ZComponent=0, System=PlaneXY(0, 0, 0))
division_12 = Division(A=eval_2, B="2")
X_7 = UnitX(Factor=division_12)
rec_2pt = Rectangle2Pt(Plane=PlaneXY(0, 0, 0), PointA=Y_6, PointB=pt_47, Radius=0)  # -> Rectangle, Length
yz_3 = YZPlane(Origin=X_7)
mirror_5 = Mirror(Geometry=rec_2pt.Rectangle, Plane=yz_3)  # -> Geometry, Transform
crv = Curve([rec_2pt.Rectangle, mirror_5.Geometry])

merge_2 = Merge(Data1=pt_45, Data2=pt_44, Data3=pt_42)
pline_2 = PolyLine(Vertices=merge_2, Closed=False)
fillet = Fillet(Curve=pline_2, Radius=Slider(10, range=0..10))

addition_11 = Addition(A=eval_2, B=eval)
folding_curves = Curve([ln_7, move.Geometry, ln_4, ln_3, mirror_4.Geometry, ln_6, ln_5, ln, ln_2])
division_13 = Division(A=addition_11, B="50")
int = Integer(division_13)
swatch = ColourSwatch(SwatchColor=RGB(0, 0, 0))
swatch_2 = ColourSwatch(SwatchColor=RGB(255, 0, 0))
outline = Curve([join, crv])
dash = DashPattern(Curve=folding_curves, Pattern=int)  # -> Dashes, Gaps
preview = CustomPreview(Geometry=outline, Shader=swatch)
preview_2 = CustomPreview(Geometry=dash.Dashes, Shader=swatch_2)
bake = ObjectBake(
    BakeToggle=bakebutton,
    GeometryObjects=folding_curves,
    Layer="Folding lines",
    ObjectName="GH_Obj",
    ObjectColor=swatch_2,
    LayerColor=swatch_2)
bake_2 = ObjectBake(
    BakeToggle=bakebutton,
    GeometryObjects=outline,
    Layer="Contour",
    ObjectName="GH_Obj",
    ObjectColor=swatch,
    LayerColor=swatch)
