# Grasshopper definition 150713 Two part box cut and fold lines generator.gh (Grasshopper 0.9.76)
# plug-ins: LunchBox

Y = Slider(122, range=0..1000)
W = Slider(50, range=0..100)
X = Slider(208, range=0..1000)
Z = Slider(50, range=0..500)
U = Slider(1, range=0.1..5)
button = Button()
division = Division(A=Y, B="2")
division_2 = Division(A=X, B="2")
eval = Evaluate(F="((y/2)-1)+((x/2)-1)", x=X, y=Y)
eval_2 = Evaluate(F="-((y/2)+(u*1.1))", y=Y, u=U)
eval_3 = Evaluate(F="-((y/2)+z)", y=Y, z=Z)
eval_4 = Evaluate(F="((y/2)-1)+(x/2)", x=X, y=Y)
eval_5 = Evaluate(F="-((y/2)+z)", y=Y, z=Z)
eval_6 = Evaluate(F="-((y/2)+(z/5))", y=Y, z=Z)
eval_7 = Evaluate(F="((y/2)-1)+(((x/2)-1)-(x/14))", x=X, y=Y)
eval_8 = Evaluate(F="(x/2)", x=X)
eval_9 = Evaluate(F="-((y/2)+(u*1.1))", y=Y, u=U)
eval_10 = Evaluate(F="((x/2)+z+(z-u)+(3*u)+(3*u))", x=X, z=Z, u=U)
eval_11 = Evaluate(F="-(w/2)", w=W)
eval_12 = Evaluate(F="((x/2)+z+(z-u)+(3*u))", x=X, z=Z, u=U)
eval_13 = Evaluate(F="((x/2)+z+(z-u)+(3*u))", x=X, z=Z, u=U)
eval_14 = Evaluate(F="-((w/2)-(3*u))", w=W, u=U)
eval_15 = Evaluate(F="(x/2)", x=X)
eval_16 = Evaluate(F="-((y/2)+(u*1.1)-(u*4))", y=Y, u=U)
eval_17 = Evaluate(F="-((y/2)+(u*1.1)-(u*4))", y=Y, u=U)
eval_18 = Evaluate(F="((x/2)+z+(z-u)+(3*u)+(3*u))", x=X, z=Z, u=U)
neg = Negative(Value=division)
neg_2 = Negative(Value=division_2)
dom = ConstructDomain(DomainStart=neg, DomainEnd=division)
dom_2 = ConstructDomain(DomainStart=neg_2, DomainEnd=division_2)
pt = ConstructPoint(XCoordinate=eval_4, YCoordinate=eval_5, ZCoordinate=0)
pt_2 = ConstructPoint(XCoordinate=eval, YCoordinate=eval_6, ZCoordinate=0)
pt_3 = ConstructPoint(XCoordinate=eval_7, YCoordinate=eval_2, ZCoordinate=0)
pt_4 = ConstructPoint(XCoordinate=eval_8, YCoordinate=eval_9, ZCoordinate=0)
X_2 = UnitX(Factor="0")
X_3 = UnitX(Factor=eval_10)
Y_2 = UnitY(Factor=eval_3)
pt_5 = ConstructPoint(XCoordinate=eval_15, YCoordinate=eval_16, ZCoordinate=0)
pt_6 = ConstructPoint(XCoordinate=eval_12, YCoordinate=eval_17, ZCoordinate=0)
pt_7 = ConstructPoint(XCoordinate=eval_13, YCoordinate=eval_11, ZCoordinate=0)
pt_8 = ConstructPoint(XCoordinate=eval_18, YCoordinate=eval_14, ZCoordinate=0)
rectangle = Rectangle(Plane=PlaneXY(0, 0, 0), XSize=dom_2, YSize=dom, Radius=0)  # -> Rectangle, Length
pt_9 = Point(X_2)
pt_10 = Point(Y_2)
pt_11 = Point(pt_5)
pt_12 = Point(pt_4)
pt_13 = Point(pt_3)
pt_14 = Point()
pt_15 = Point()
pt_16 = Point(pt_2)
pt_17 = Point(pt)
pt_18 = Point()
pt_19 = Point()
pt_20 = Point(pt_7)
pt_21 = Point(pt_6)
ln = Line(StartPoint=pt_18, EndPoint=pt_19)
ln_2 = Line(StartPoint=pt_14, EndPoint=pt_15)
pt_22 = Point(X_3)
pt_23 = Point(pt_8)
ln_3 = Line(StartPoint=pt_11, EndPoint=pt_12)
dist = Distance(PointA=pt_11, PointB=pt_12)
divide = DivideCurve(Curve=ln_3, Count=2, Kinks=False)  # -> Points, Tangents, Parameters
eval_19 = Evaluate(F="(x/2)", x=dist)
item = ListItem(List=divide.Points, Index=1, Wrap=True)
cir = Circle(Plane=item, Radius=eval_19)
divide_2 = DivideCurve(Curve=cir, Count=4, Kinks=False)  # -> Points, Tangents, Parameters
merge = Merge(Data1=pt_11, Data2=pt_21, Data3=pt_20, Data4=pt_23, Data5=pt_22)
merge_2 = Merge(Data1=pt_10, Data2=pt_17, Data3=pt_16, Data4=pt_13, Data5=pt_12)
item_2 = ListItem(List=divide_2.Points, Index=2, Wrap=True)
pline = PolyLine(Vertices=merge, Closed=False)
arc = Arc3Pt(PointA=pt_12, PointB=item_2, PointC=pt_11)  # -> Arc, Plane, Radius
pline_2 = PolyLine(Vertices=merge_2, Closed=False)
crv = Curve(flatten(pline))
crv_2 = Curve(flatten(arc.Arc))
crv_3 = Curve(flatten(pline_2))
join = JoinCurves(Curves=[crv, crv_2, crv_3], Preserve=False)
xz = XZPlane(Origin=Point(0, 0, 0))
mirror = Mirror(Geometry=join, Plane=xz)  # -> Geometry, Transform
join_2 = JoinCurves(Curves=[join, mirror.Geometry], Preserve=False)
yz = YZPlane(Origin=Point(0, 0, 0))
mirror_2 = Mirror(Geometry=join_2, Plane=yz)  # -> Geometry, Transform
join_3 = JoinCurves(Curves=[join_2, mirror_2.Geometry], Preserve=False)
crv_4 = Curve(join_3)
swatch = ColourSwatch(SwatchColor=RGB(255, 0, 0))
swatch_2 = ColourSwatch(SwatchColor=RGB(217, 255, 0))
bake = ObjectBake(BakeToggle=button, GeometryObjects=crv_4, Layer="Cutout", ObjectName="GH_Obj", ObjectColor=swatch, LayerColor=swatch)
preview = CustomPreview(Geometry=crv_4, Shader=swatch)
bake_2 = ObjectBake(
    BakeToggle=button,
    GeometryObjects=rectangle.Rectangle,
    Layer="Folding Lines",
    ObjectName="GH_Obj",
    ObjectColor=swatch_2,
    LayerColor=swatch_2)
preview_2 = CustomPreview(Geometry=rectangle.Rectangle, Shader=swatch_2)
