# Grasshopper definition 150715 Two part box cut and fold lines generator.gh (Grasshopper 0.9.76)
# plug-ins: LunchBox

u_thickness_material = Slider(3, range=0.1..5)
z_height = Slider(180, range=0..500)
Y = Slider(540, range=0..1000)
X = Slider(540, range=0..1000)
button = Button()
eval = Evaluate(F="-((y/2)+(u*1.1)-(u*4))", y=Y, u=u_thickness_material)
eval_2 = Evaluate(F="((y/2)-1)+((x/2)-1)", x=X, y=Y)
eval_3 = Evaluate(F="-((y/2)+(u*1.1))", y=Y, u=u_thickness_material)
eval_4 = Evaluate(F="((x/2)+z+(u*3))", x=X, z=z_height, u=u_thickness_material)
eval_5 = Evaluate(F="-((y/2)+z)", y=Y, z=z_height)
eval_6 = Evaluate(F="((y/2)-1)+(x/2)", x=X, y=Y)
eval_7 = Evaluate(F="-((y/2)+z)", y=Y, z=z_height)
eval_8 = Evaluate(F="-((y/2)+(z/5))", y=Y, z=z_height)
eval_9 = Evaluate(F="((y/2)-1)+(((x/2)-1)-(x/14))", x=X, y=Y)
eval_10 = Evaluate(F="(x/2)", x=X)
eval_11 = Evaluate(F="-(((z-((u*4)*2))/2)-3*u)", u=u_thickness_material, z=z_height)
eval_12 = Evaluate(F="-(y/2)", y=Y)
eval_13 = Evaluate(F="-((y/2)+(u*1.1)-(u*4))", y=Y, u=u_thickness_material)
eval_14 = Evaluate(F="-((y/2)+(u*1.1))", y=Y, u=u_thickness_material)
eval_15 = Evaluate(F="(x/2-u)", x=X, u=u_thickness_material)
eval_16 = Evaluate(F="-((y/2)+z)", y=Y, z=z_height)
eval_17 = Evaluate(F="((x/2)+z)", x=X, z=z_height)
eval_18 = Evaluate(F="((x/2)+z+(z-u)+(3*u))", x=X, z=z_height, u=u_thickness_material)
eval_19 = Evaluate(F="((x/2)+z+(z-u)+(3*u))", x=X, z=z_height, u=u_thickness_material)
eval_20 = Evaluate(F="-((z-((u*4)*2))/2)", u=u_thickness_material, z=z_height)
eval_21 = Evaluate(F="(x/2)", x=X)
eval_22 = Evaluate(F="-((y/2)+(u*1.1)-(u*4))", y=Y, u=u_thickness_material)
eval_23 = Evaluate(F="-((y/2)+(u*1.1)-(u*4))", y=Y, u=u_thickness_material)
eval_24 = Evaluate(F="((x/2)+z+(z-u)+(3*u)+(6*u))", x=X, z=z_height, u=u_thickness_material)
division = Division(A=Y, B="2")
division_2 = Division(A=X, B="2")
eval_25 = Evaluate(F="(x/2-((u*4)))", u=u_thickness_material, x=X)
eval_26 = Evaluate(F="(u*4)", u=u_thickness_material)
eval_27 = Evaluate(F="(z-((u*4)*2))", u=u_thickness_material, z=z_height)
division_3 = Division(A=eval_27, B="2")
neg = Negative(Value=division)
neg_2 = Negative(Value=division_2)
neg_3 = Negative(Value=division_3)
dom = ConstructDomain(DomainStart=neg, DomainEnd=division)
dom_2 = ConstructDomain(DomainStart=neg_2, DomainEnd=division_2)
pt = ConstructPoint(XCoordinate=eval_25, YCoordinate=neg_3, ZCoordinate=0)
division_4 = Division(A=eval_26, B="2")
pt_2 = ConstructPoint(XCoordinate=eval_6, YCoordinate=eval_7, ZCoordinate=0)
pt_3 = ConstructPoint(XCoordinate=eval_2, YCoordinate=eval_8, ZCoordinate=0)
pt_4 = ConstructPoint(XCoordinate=eval_9, YCoordinate=eval_3, ZCoordinate=0)
pt_5 = ConstructPoint(XCoordinate=eval_10, YCoordinate=eval_14, ZCoordinate=0)
X_2 = UnitX(Factor="0")
X_3 = UnitX(Factor=eval_24)
Y_2 = UnitY(Factor=eval_5)
pt_6 = ConstructPoint(XCoordinate=eval_21, YCoordinate=eval_22, ZCoordinate=0)
pt_7 = ConstructPoint(XCoordinate=eval_18, YCoordinate=eval_23, ZCoordinate=0)
pt_8 = ConstructPoint(XCoordinate=eval_19, YCoordinate=eval_20, ZCoordinate=0)
pt_9 = ConstructPoint(XCoordinate=eval_15, YCoordinate=eval_16, ZCoordinate=0)
pt_10 = ConstructPoint(XCoordinate=eval_24, YCoordinate=eval_11, ZCoordinate=0)
pt_11 = ConstructPoint(XCoordinate=eval_15, YCoordinate=eval_12, ZCoordinate=0)
pt_12 = ConstructPoint(XCoordinate=eval_4, YCoordinate=eval, ZCoordinate=0)
pt_13 = ConstructPoint(XCoordinate=eval_17, YCoordinate=eval_13, ZCoordinate=0)
X_4 = UnitX(Factor=eval_4)
X_5 = UnitX(Factor=eval_17)
rectangle = Rectangle(Plane=PlaneXY(0, 0, 0), XSize=dom_2, YSize=dom, Radius=0)  # -> Rectangle, Length
rectangle_2 = Rectangle(Plane=pt, XSize=eval_26, YSize=eval_27, Radius=division_4)  # -> Rectangle, Length
pt_14 = Point(X_2)
pt_15 = Point(Y_2)

pt_16 = Point(pt_9)
pt_17 = Point(pt_11)
pt_18 = Point(X_5)
pt_19 = Point(pt_13)
pt_20 = Point(X_4)
pt_21 = Point(pt_12)

pt_22 = Point(pt_6)
pt_23 = Point(pt_5)
pt_24 = Point(pt_4)
pt_25 = Point(pt_3)
pt_26 = Point(pt_2)
pt_27 = Point(pt_8)
pt_28 = Point(pt_7)
pt_29 = Point(X_3)
pt_30 = Point(pt_10)
ln = Line(StartPoint=pt_22, EndPoint=pt_23)
dist = Distance(PointA=pt_22, PointB=pt_23)
divide = DivideCurve(Curve=ln, Count=2, Kinks=False)  # -> Points, Tangents, Parameters
eval_28 = Evaluate(F="(x/2)", x=dist)
item = ListItem(List=divide.Points, Index=1, Wrap=True)
cir = Circle(Plane=item, Radius=eval_28)
divide_2 = DivideCurve(Curve=cir, Count=4, Kinks=False)  # -> Points, Tangents, Parameters
merge = Merge(Data1=pt_22, Data2=pt_28, Data3=pt_27, Data4=pt_30, Data5=pt_29)
merge_2 = Merge(Data1=pt_15, Data2=pt_26, Data3=pt_25, Data4=pt_24, Data5=pt_23)
item_2 = ListItem(List=divide_2.Points, Index=2, Wrap=True)
ln_2 = Line(StartPoint=pt_18, EndPoint=pt_19)
ln_3 = Line(StartPoint=pt_16, EndPoint=pt_17)
ln_4 = Line(StartPoint=pt_20, EndPoint=pt_21)
pline = PolyLine(Vertices=merge, Closed=False)
arc = Arc3Pt(PointA=pt_23, PointB=item_2, PointC=pt_22)  # -> Arc, Plane, Radius
pline_2 = PolyLine(Vertices=merge_2, Closed=False)
xz = XZPlane(Origin=Point(0, 0, 0))
xz_2 = XZPlane(Origin=Point(0, 0, 0))
xz_3 = XZPlane(Origin=Point(0, 0, 0))
crv = Curve(flatten(pline))
crv_2 = Curve(flatten(arc.Arc))
crv_3 = Curve(flatten(pline_2))
mirror = Mirror(Geometry=ln_3, Plane=xz)  # -> Geometry, Transform
mirror_2 = Mirror(Geometry=ln_4, Plane=xz_2)  # -> Geometry, Transform
mirror_3 = Mirror(Geometry=ln_2, Plane=xz_3)  # -> Geometry, Transform
join = JoinCurves(Curves=[mirror_2.Geometry, ln_4], Preserve=False)
join_2 = JoinCurves(Curves=[mirror_3.Geometry, ln_2], Preserve=False)
join_3 = JoinCurves(Curves=[crv, crv_2, crv_3], Preserve=False)
yz = YZPlane(Origin=Point(0, 0, 0))
yz_2 = YZPlane(Origin=Point(0, 0, 0))
yz_3 = YZPlane(Origin=Point(0, 0, 0))
xz_4 = XZPlane(Origin=Point(0, 0, 0))
mirror_4 = Mirror(Geometry=[mirror.Geometry, ln_3], Plane=yz)  # -> Geometry, Transform
mirror_5 = Mirror(Geometry=join, Plane=yz_2)  # -> Geometry, Transform
mirror_6 = Mirror(Geometry=join_2, Plane=yz_3)  # -> Geometry, Transform
mirror_7 = Mirror(Geometry=join_3, Plane=xz_4)  # -> Geometry, Transform
join_4 = JoinCurves(Curves=[join, mirror_5.Geometry], Preserve=False)
join_5 = JoinCurves(Curves=[join_2, mirror_6.Geometry], Preserve=False)
crv_4 = Curve([ln_3, mirror.Geometry, mirror_4.Geometry])
join_6 = JoinCurves(Curves=[join_3, mirror_7.Geometry], Preserve=False)
crv_5 = Curve(join_4)
crv_6 = Curve(join_5)
yz_4 = YZPlane(Origin=Point(0, 0, 0))
crv_7 = Curve(rectangle_2.Rectangle)
mirror_8 = Mirror(Geometry=join_6, Plane=yz_4)  # -> Geometry, Transform
yz_5 = YZPlane(Origin=Point(0, 0, 0))
mirror_9 = Mirror(Geometry=crv_7, Plane=yz_5)  # -> Geometry, Transform
join_7 = JoinCurves(Curves=[join_6, mirror_8.Geometry], Preserve=False)
crv_8 = Curve([crv_7, mirror_9.Geometry])
crv_9 = Curve(join_7)
swatch = ColourSwatch(SwatchColor=RGB(255, 0, 0))
swatch_2 = ColourSwatch(SwatchColor=RGB(217, 255, 0))
crv_10 = Curve(flatten([rectangle.Rectangle, crv_4, crv_6, crv_5]))
bake = ObjectBake(
    BakeToggle=button,
    GeometryObjects=[crv_9, crv_8],
    Layer="Cutout",
    ObjectName="GH_Obj",
    ObjectColor=swatch,
    LayerColor=swatch)
preview = CustomPreview(Geometry=[crv_9, crv_8], Shader=swatch)
bake_2 = ObjectBake(
    BakeToggle=button,
    GeometryObjects=crv_10,
    Layer="Folding Lines",
    ObjectName="GH_Obj",
    ObjectColor=swatch_2,
    LayerColor=swatch_2)
preview_2 = CustomPreview(Geometry=[rectangle.Rectangle, crv_4, crv_5, crv_6], Shader=swatch_2)
