# Grasshopper definition 150718 Two part box cut and fold lines generator.gh (Grasshopper 0.9.76)
# plug-ins: LunchBox

u_thickness_material = Slider(3, range=0.1..5)
radius_hole = Slider(14, range=0..30)
z_height = Slider(20, range=0..500)
X = Slider(220, range=0..1000)
Y = Slider(305, range=0..1000)
top_of_box = BooleanToggle(True)
bakebutton = Button()
logo_optional = Curve([<curve referenced from the Rhino model> x4])
eval = Evaluate(F="(x+u*7)", u=u_thickness_material, x=X)
eval_2 = Evaluate(F="x+(2*u)", x=eval, u=u_thickness_material)
eval_3 = Evaluate(F="y+(2*u)", y=Y, u=u_thickness_material)
eval_4 = Evaluate(F="z+(2*u)", z=z_height, u=u_thickness_material)
cull = CullPattern(List=eval_2, CullPattern=top_of_box)
cull_2 = CullPattern(List=eval_3, CullPattern=top_of_box)
cull_3 = CullPattern(List=eval_4, CullPattern=top_of_box)
eval_5 = Evaluate(F="-((y/2)+z)", y=cull_2, z=cull_3)
eval_6 = Evaluate(F="-((y/2)+(u*1.1)-(u*4))", y=cull_2, u=u_thickness_material)
eval_7 = Evaluate(F="((y/2)-1)+((x/2)-1)", x=cull, y=cull_2)
eval_8 = Evaluate(F="-((y/2)+(u*1.1))", y=cull_2, u=u_thickness_material)
eval_9 = Evaluate(F="((x/2)+z+(u*3))", x=cull, z=cull_3, u=u_thickness_material)
eval_10 = Evaluate(F="((y/2)-1)+(x/2)", x=cull, y=cull_2)
eval_11 = Evaluate(F="-((y/2)+z)", y=cull_2, z=cull_3)
eval_12 = Evaluate(F="-((y/2)+(z/5))", y=cull_2, z=cull_3)
eval_13 = Evaluate(F="((y/2)-1)+(((x/2)-1)-(x/14))", x=cull, y=cull_2)
eval_14 = Evaluate(F="(x/2)", x=cull)
eval_15 = Evaluate(F="-(y/2)", y=cull_2)
eval_16 = Evaluate(F="-((y/2)+(u*1.1)-(u*4))", y=cull_2, u=u_thickness_material)
eval_17 = Evaluate(F="-((y/2)+z)", y=cull_2, z=cull_3)
eval_18 = Evaluate(F="-((y/2)+(u*1.1))", y=cull_2, u=u_thickness_material)
eval_19 = Evaluate(F="(x/2-u)", x=cull, u=u_thickness_material)
eval_20 = Evaluate(F="-((y/2)+z)", y=cull_2, z=cull_3)
eval_21 = Evaluate(F="((x/2)+z)", x=cull, z=cull_3)
eval_22 = Evaluate(F="((x/2)+z+(z-u)+(3*u))", x=cull, z=cull_3, u=u_thickness_material)
eval_23 = Evaluate(F="((x/2)+z+(z-u)+(3*u))", x=cull, z=cull_3, u=u_thickness_material)
eval_24 = Evaluate(F="(x/2)", x=cull)
eval_25 = Evaluate(F="-((y/2)+(u*1.1)-(u*4))", y=cull_2, u=u_thickness_material)
eval_26 = Evaluate(F="-((y/2)+(u*1.1)-(u*4))", y=cull_2, u=u_thickness_material)
eval_27 = Evaluate(F="((x/2)+z+(z-u)+(3*u)+(3*u))", x=cull, z=cull_3, u=u_thickness_material)
eval_28 = Evaluate(F="-(((y/3)/2))", u=u_thickness_material, y=cull_2, z=cull_3)
eval_29 = Evaluate(F="-((y/3)/2-(u*4))", u=u_thickness_material, y=cull_2, z=cull_3)
eval_30 = Evaluate(F="-((y/2)+(u*1.1)-(u*4))", y=Y, u=u_thickness_material)
eval_31 = Evaluate(F="((y/2)-1)+((x/2)-1)", x=eval, y=Y)
eval_32 = Evaluate(F="-((y/2)+(u*1.1))", y=Y, u=u_thickness_material)
eval_33 = Evaluate(F="((x/2)+z+(u*3))", x=eval, z=z_height, u=u_thickness_material)
division = Division(A=cull_2, B="2")
eval_34 = Evaluate(F="-((y/2)+z)", y=Y, z=z_height)
eval_35 = Evaluate(F="((y/2)-1)+(x/2)", x=eval, y=Y)
eval_36 = Evaluate(F="-((y/2)+z)", y=Y, z=z_height)
eval_37 = Evaluate(F="-((y/2)+(z/5))", y=Y, z=z_height)
eval_38 = Evaluate(F="((y/2)-1)+(((x/2)-1)-(x/14))", x=eval, y=Y)
eval_39 = Evaluate(F="(x/2)", x=eval)
eval_40 = Evaluate(F="-(y/2)", y=Y)
eval_41 = Evaluate(F="-((y/2)+(u*1.1)-(u*4))", y=Y, u=u_thickness_material)
division_2 = Division(A=cull, B="2")
eval_42 = Evaluate(F="-((y/2)+(u*1.1))", y=Y, u=u_thickness_material)
eval_43 = Evaluate(F="(x/2-u)", x=eval, u=u_thickness_material)
eval_44 = Evaluate(F="-((y/2)+z)", y=Y, z=z_height)
eval_45 = Evaluate(F="((x/2)+z)", x=eval, z=z_height)
eval_46 = Evaluate(F="-(((y/3))+(u))", u=u_thickness_material, y=cull_2, z=cull_3)
eval_47 = Evaluate(F="((x/2)+z+(z-u)+(3*u))", x=eval, z=z_height, u=u_thickness_material)
eval_48 = Evaluate(F="((x/2)+z+(z-u)+(3*u))", x=eval, z=z_height, u=u_thickness_material)
eval_49 = Evaluate(F="(u*3)", u=u_thickness_material)
eval_50 = Evaluate(F="(x/2-(r))", r=eval_49, x=cull)
eval_51 = Evaluate(F="(x/2)", x=eval)
eval_52 = Evaluate(F="-((y/2)+(u*1.1)-(u*4))", y=Y, u=u_thickness_material)
eval_53 = Evaluate(F="-((y/2)+(u*1.1)-(u*4))", y=Y, u=u_thickness_material)
eval_54 = Evaluate(F="((x/2)+z+(z-u)+(3*u)+(3*u))", x=eval, z=z_height, u=u_thickness_material)
eval_55 = Evaluate(F="-(((y/3)/2))", u=u_thickness_material, y=Y, z=z_height)
eval_56 = Evaluate(F="-((y/3)/2-(u*4))", u=u_thickness_material, y=Y, z=z_height)
division_3 = Division(A=Y, B="2")
division_4 = Division(A=eval, B="2")
eval_57 = Evaluate(F="-(((y/3))+(u))", u=u_thickness_material, y=Y, z=z_height)
eval_58 = Evaluate(F="(u*3)", u=u_thickness_material)
eval_59 = Evaluate(F="(x/2-(r))", x=eval, r=eval_58)
division_5 = Division(A=eval_46, B="2")
neg = Negative(Value=division)
division_6 = Division(A=eval_57, B="2")
neg_2 = Negative(Value=division_2)
neg_3 = Negative(Value=division_3)
neg_4 = Negative(Value=division_4)
neg_5 = Negative(Value=division_5)
neg_6 = Negative(Value=division_6)
dom = ConstructDomain(DomainStart=neg, DomainEnd=division)
dom_2 = ConstructDomain(DomainStart=neg_2, DomainEnd=division_2)
dom_3 = ConstructDomain(DomainStart=neg_3, DomainEnd=division_3)
dom_4 = ConstructDomain(DomainStart=neg_4, DomainEnd=division_4)
pt = ConstructPoint(XCoordinate=eval_50, YCoordinate=neg_5, ZCoordinate=0)
pt_2 = ConstructPoint(XCoordinate=eval_59, YCoordinate=neg_6, ZCoordinate=0)
division_7 = Division(A=eval_49, B="2")
division_8 = Division(A=eval_58, B="2")
pt_3 = ConstructPoint(XCoordinate=0, YCoordinate=eval_17, ZCoordinate=0)
pt_4 = ConstructPoint(XCoordinate=eval_10, YCoordinate=eval_11, ZCoordinate=0)
pt_5 = ConstructPoint(XCoordinate=eval_7, YCoordinate=eval_12, ZCoordinate=0)
pt_6 = ConstructPoint(XCoordinate=eval_13, YCoordinate=eval_8, ZCoordinate=0)
pt_7 = ConstructPoint(XCoordinate=eval_14, YCoordinate=eval_18, ZCoordinate=0)
X_2 = UnitX(Factor="0")
X_3 = UnitX(Factor=eval_27)
Y_2 = UnitY(Factor=eval_5)
pt_8 = ConstructPoint(XCoordinate=eval_24, YCoordinate=eval_25, ZCoordinate=0)
pt_9 = ConstructPoint(XCoordinate=eval_22, YCoordinate=eval_26, ZCoordinate=0)
pt_10 = ConstructPoint(XCoordinate=eval_23, YCoordinate=eval_28, ZCoordinate=0)
pt_11 = ConstructPoint(XCoordinate=eval_19, YCoordinate=eval_20, ZCoordinate=0)
pt_12 = ConstructPoint(XCoordinate=radius_hole, YCoordinate=eval_17, ZCoordinate=0)
pt_13 = ConstructPoint(XCoordinate=eval_27, YCoordinate=eval_29, ZCoordinate=0)
pt_14 = ConstructPoint(XCoordinate=eval_35, YCoordinate=eval_36, ZCoordinate=0)
pt_15 = ConstructPoint(XCoordinate=eval_31, YCoordinate=eval_37, ZCoordinate=0)
pt_16 = ConstructPoint(XCoordinate=eval_38, YCoordinate=eval_32, ZCoordinate=0)
pt_17 = ConstructPoint(XCoordinate=eval_39, YCoordinate=eval_42, ZCoordinate=0)
pt_18 = ConstructPoint(XCoordinate=eval_19, YCoordinate=eval_15, ZCoordinate=0)
X_4 = UnitX(Factor="0")
X_5 = UnitX(Factor=eval_54)
Y_3 = UnitY(Factor=eval_34)
pt_19 = ConstructPoint(XCoordinate=eval_51, YCoordinate=eval_52, ZCoordinate=0)
pt_20 = ConstructPoint(XCoordinate=eval_47, YCoordinate=eval_53, ZCoordinate=0)
pt_21 = ConstructPoint(XCoordinate=eval_48, YCoordinate=eval_55, ZCoordinate=0)
pt_22 = ConstructPoint(XCoordinate=eval_43, YCoordinate=eval_44, ZCoordinate=0)
pt_23 = ConstructPoint(XCoordinate=eval_9, YCoordinate=eval_6, ZCoordinate=0)
pt_24 = ConstructPoint(XCoordinate=eval_54, YCoordinate=eval_56, ZCoordinate=0)
pt_25 = ConstructPoint(XCoordinate=eval_21, YCoordinate=eval_16, ZCoordinate=0)
X_6 = UnitX(Factor=eval_9)
pt_26 = ConstructPoint(XCoordinate=eval_43, YCoordinate=eval_40, ZCoordinate=0)
X_7 = UnitX(Factor=eval_21)
pt_27 = ConstructPoint(XCoordinate=eval_33, YCoordinate=eval_30, ZCoordinate=0)
pt_28 = ConstructPoint(XCoordinate=eval_45, YCoordinate=eval_41, ZCoordinate=0)
X_8 = UnitX(Factor=eval_33)
X_9 = UnitX(Factor=eval_45)
rectangle = Rectangle(Plane=PlaneXY(0, 0, 0), XSize=dom_2, YSize=dom, Radius=0)  # -> Rectangle, Length
rectangle_2 = Rectangle(Plane=pt, XSize=eval_49, YSize=eval_46, Radius=division_7)  # -> Rectangle, Length
rectangle_3 = Rectangle(Plane=PlaneXY(0, 0, 0), XSize=dom_4, YSize=dom_3, Radius=0)  # -> Rectangle, Length
rectangle_4 = Rectangle(Plane=pt_2, XSize=eval_58, YSize=eval_57, Radius=division_8)  # -> Rectangle, Length
crv = Curve(rectangle_2.Rectangle)

pt_29 = Point(X_4)
pt_30 = Point(Y_3)
pt_31 = Point(pt_19)
pt_32 = Point(pt_17)
pt_33 = Point(pt_16)
pt_34 = Point(pt_15)
pt_35 = Point(pt_14)
pt_36 = Point(pt_21)
pt_37 = Point(pt_20)
pt_38 = Point(X_5)
pt_39 = Point(pt_24)

pt_40 = Point(Y_2)
pt_41 = Point(X_2)
pt_42 = Point(pt_8)
pt_43 = Point(pt_7)
pt_44 = Point(pt_6)
pt_45 = Point(pt_4)
pt_46 = Point(pt_5)
pt_47 = Point(pt_10)
pt_48 = Point(pt_9)
pt_49 = Point(pt_13)
pt_50 = Point(X_3)

pt_51 = Point(pt_12)

pt_52 = Point(pt_22)
pt_53 = Point(pt_26)
pt_54 = Point(X_9)
pt_55 = Point(pt_28)
pt_56 = Point(X_8)
pt_57 = Point(pt_27)

pt_58 = Point(pt_11)
pt_59 = Point(pt_18)
pt_60 = Point(X_7)
pt_61 = Point(pt_25)
pt_62 = Point(X_6)
pt_63 = Point(pt_23)

ln = Line(StartPoint=pt_31, EndPoint=pt_32)
dist = Distance(PointA=pt_31, PointB=pt_32)
divide = DivideCurve(Curve=ln, Count=2, Kinks=False)  # -> Points, Tangents, Parameters
ln_2 = Line(StartPoint=pt_42, EndPoint=pt_43)
dist_2 = Distance(PointA=pt_42, PointB=pt_43)
eval_60 = Evaluate(F="(x/2)", x=dist)
item = ListItem(List=divide.Points, Index=1, Wrap=True)
divide_2 = DivideCurve(Curve=ln_2, Count=2, Kinks=False)  # -> Points, Tangents, Parameters
eval_61 = Evaluate(F="(x/2)", x=dist_2)
cir = Circle(Plane=item, Radius=eval_60)
item_2 = ListItem(List=divide_2.Points, Index=1, Wrap=True)
divide_3 = DivideCurve(Curve=cir, Count=4, Kinks=False)  # -> Points, Tangents, Parameters
cir_2 = Circle(Plane=item_2, Radius=eval_61)
merge = Merge(Data1=pt_31, Data2=pt_37, Data3=pt_36, Data4=pt_39, Data5=pt_38)
merge_2 = Merge(Data1=pt_30, Data2=pt_35, Data3=pt_34, Data4=pt_33, Data5=pt_32)
item_3 = ListItem(List=divide_3.Points, Index=2, Wrap=True)
divide_4 = DivideCurve(Curve=cir_2, Count=4, Kinks=False)  # -> Points, Tangents, Parameters
ln_3 = Line(StartPoint=pt_54, EndPoint=pt_55)
ln_4 = Line(StartPoint=pt_52, EndPoint=pt_53)
ln_5 = Line(StartPoint=pt_56, EndPoint=pt_57)
pline = PolyLine(Vertices=merge, Closed=False)
merge_3 = Merge(Data1=pt_42, Data2=pt_48, Data3=pt_47, Data4=pt_49, Data5=pt_50)
arc = Arc3Pt(PointA=pt_32, PointB=item_3, PointC=pt_31)  # -> Arc, Plane, Radius
pline_2 = PolyLine(Vertices=merge_2, Closed=False)
merge_4 = Merge(Data1=pt_51, Data2=pt_45, Data3=pt_46, Data4=pt_44, Data5=pt_43)
item_4 = ListItem(List=divide_4.Points, Index=2, Wrap=True)
ln_6 = Line(StartPoint=pt_60, EndPoint=pt_61)
ln_7 = Line(StartPoint=pt_58, EndPoint=pt_59)
ln_8 = Line(StartPoint=pt_62, EndPoint=pt_63)
xz = XZPlane(Origin=Point(0, 0, 0))
xz_2 = XZPlane(Origin=Point(0, 0, 0))
xz_3 = XZPlane(Origin=Point(0, 0, 0))
pline_3 = PolyLine(Vertices=merge_3, Closed=False)
crv_2 = Curve(flatten(pline))
crv_3 = Curve(flatten(arc.Arc))
crv_4 = Curve(flatten(pline_2))
arc_2 = Arc3Pt(PointA=pt_43, PointB=item_4, PointC=pt_42)  # -> Arc, Plane, Radius
pline_4 = PolyLine(Vertices=merge_4, Closed=False)
arc_3 = Arc(Plane=pt_40, Radius=radius_hole, Angle=Domain(0, 1.570796327))  # -> Arc, Length
xz_4 = XZPlane(Origin=Point(0, 0, 0))
xz_5 = XZPlane(Origin=Point(0, 0, 0))
xz_6 = XZPlane(Origin=Point(0, 0, 0))
mirror = Mirror(Geometry=ln_4, Plane=xz)  # -> Geometry, Transform
mirror_2 = Mirror(Geometry=ln_5, Plane=xz_2)  # -> Geometry, Transform
mirror_3 = Mirror(Geometry=ln_3, Plane=xz_3)  # -> Geometry, Transform
crv_5 = Curve(flatten(pline_3))
crv_6 = Curve(flatten(arc_2.Arc))
crv_7 = Curve(flatten(pline_4))
crv_8 = Curve(flatten(arc_3.Arc))
mirror_4 = Mirror(Geometry=ln_7, Plane=xz_4)  # -> Geometry, Transform
mirror_5 = Mirror(Geometry=ln_8, Plane=xz_5)  # -> Geometry, Transform
mirror_6 = Mirror(Geometry=ln_6, Plane=xz_6)  # -> Geometry, Transform
yz = YZPlane(Origin=Point(0, 0, 0))
join = JoinCurves(Curves=[mirror_2.Geometry, ln_5], Preserve=False)
join_2 = JoinCurves(Curves=[mirror_3.Geometry, ln_3], Preserve=False)
crv_9 = Curve(logo_optional)
join_3 = JoinCurves(Curves=[crv_2, crv_3, crv_4], Preserve=False)
mirror_7 = Mirror(Geometry=crv_9, Plane=yz)  # -> Geometry, Transform
yz_2 = YZPlane(Origin=Point(0, 0, 0))
xy = XYPlane(Origin=pt_60)
yz_3 = YZPlane(Origin=Point(0, 0, 0))
xy_2 = XYPlane(Origin=pt_62)
yz_4 = YZPlane(Origin=Point(0, 0, 0))
join_4 = JoinCurves(Curves=[mirror_5.Geometry, ln_8], Preserve=False)
join_5 = JoinCurves(Curves=[mirror_6.Geometry, ln_6], Preserve=False)
join_6 = JoinCurves(Curves=[crv_5, crv_6, crv_7, crv_8], Preserve=False)
xz_7 = XZPlane(Origin=Point(0, 0, 0))
mirror_8 = Mirror(Geometry=[mirror.Geometry, ln_4], Plane=yz_2)  # -> Geometry, Transform
yz_5 = YZPlane(Origin=Point(0, 0, 0))
mirror_9 = Mirror(Geometry=join, Plane=yz_3)  # -> Geometry, Transform
mirror_10 = Mirror(Geometry=join_2, Plane=yz_4)  # -> Geometry, Transform
yz_6 = YZPlane(Origin=Point(0, 0, 0))
yz_7 = YZPlane(Origin=Point(0, 0, 0))
arc_4 = Arc(Plane=xy, Radius=radius_hole, Angle=Domain(0, 3.141592654))  # -> Arc, Length
arc_5 = Arc(Plane=xy_2, Radius=radius_hole, Angle=Domain(0, 3.141592654))  # -> Arc, Length
xz_8 = XZPlane(Origin=Point(0, 0, 0))
mirror_11 = Mirror(Geometry=join_3, Plane=xz_7)  # -> Geometry, Transform
mirror_12 = Mirror(Geometry=[mirror_4.Geometry, ln_7], Plane=yz_5)  # -> Geometry, Transform
mirror_13 = Mirror(Geometry=join_4, Plane=yz_6)  # -> Geometry, Transform
mirror_14 = Mirror(Geometry=join_5, Plane=yz_7)  # -> Geometry, Transform
group = Group(Objects=mirror_7.Geometry)
join_7 = JoinCurves(Curves=[join, mirror_9.Geometry], Preserve=False)
join_8 = JoinCurves(Curves=[join_2, mirror_10.Geometry], Preserve=False)
rad = Radians(Degrees=90)
rad_2 = Radians(Degrees=-90)
mirror_15 = Mirror(Geometry=join_6, Plane=xz_8)  # -> Geometry, Transform
bbox = BoundingBox(Content=group, Plane=PlaneXY(0, 0, 0))  # -> Box, Box_2
join_9 = JoinCurves(Curves=[join_3, mirror_11.Geometry], Preserve=False)
join_10 = JoinCurves(Curves=[join_4, mirror_13.Geometry], Preserve=False)
join_11 = JoinCurves(Curves=[join_5, mirror_14.Geometry], Preserve=False)
crv_10 = Curve(join_8)
crv_11 = Curve(join_7)
crv_12 = Curve([ln_4, mirror.Geometry, mirror_8.Geometry])
rotate = Rotate(Geometry=arc_4.Arc, Angle=rad, Plane=xy)  # -> Geometry, Transform
rotate_2 = Rotate(Geometry=arc_5.Arc, Angle=rad_2, Plane=xy_2)  # -> Geometry, Transform
area = Area(Geometry=bbox.Box)  # -> Area, Centroid
yz_8 = YZPlane(Origin=Point(0, 0, 0))
join_12 = JoinCurves(Curves=[join_6, mirror_15.Geometry], Preserve=False)
end = EndPoints(Curve=rotate_2.Geometry)  # -> Start, End
end_2 = EndPoints(Curve=rotate.Geometry)  # -> Start, End
crv_13 = Curve(rectangle_4.Rectangle)
mirror_16 = Mirror(Geometry=join_9, Plane=yz_8)  # -> Geometry, Transform
yz_9 = YZPlane(Origin=Point(0, 0, 0))
yz_10 = YZPlane(Origin=Point(0, 0, 0))
mirror_17 = Mirror(Geometry=join_12, Plane=yz_9)  # -> Geometry, Transform
mirror_18 = Mirror(Geometry=crv_13, Plane=yz_10)  # -> Geometry, Transform
ln_9 = Line(StartPoint=end_2.End, EndPoint=end.Start)
ln_10 = Line(StartPoint=end_2.Start, EndPoint=end.End)
yz_11 = YZPlane(Origin=Point(0, 0, 0))
join_13 = JoinCurves(Curves=[join_9, mirror_16.Geometry], Preserve=False)
mirror_19 = Mirror(Geometry=crv, Plane=yz_11)  # -> Geometry, Transform
crv_14 = Curve([crv_13, mirror_18.Geometry])
join_14 = JoinCurves(Curves=[rotate.Geometry, ln_10, ln_9, rotate_2.Geometry], Preserve=False)
crv_15 = Curve(join_13)
join_15 = JoinCurves(Curves=[join_12, mirror_17.Geometry], Preserve=False)
yz_12 = YZPlane(Origin=Point(0, 0, 0))
crv_16 = Curve(join_11)
crv_17 = Curve(join_10)
crv_18 = Curve([ln_7, mirror_4.Geometry, mirror_12.Geometry])
crv_19 = Curve(join_15)
crv_20 = Curve(rectangle.Rectangle)
crv_21 = Curve([crv, mirror_19.Geometry])
mirror_20 = Mirror(Geometry=join_14, Plane=yz_12)  # -> Geometry, Transform
bbox_2 = BoundingBox(Content=crv_19, Plane=PlaneXY(0, 0, 0))  # -> Box, Box_2
crv_22 = Curve([join_14, mirror_20.Geometry])
debox = DeconstructBox(Box=bbox_2.Box)  # -> Plane, X, Y, Z
int = Integer(debox.Y)
Y_4 = UnitY(Factor=int)
move = Move(Geometry=crv_22, Motion=Y_4)  # -> Geometry, Transform
move_2 = Move(Geometry=crv_16, Motion=Y_4)  # -> Geometry, Transform
move_3 = Move(Geometry=crv_17, Motion=Y_4)  # -> Geometry, Transform
move_4 = Move(Geometry=crv_18, Motion=Y_4)  # -> Geometry, Transform
move_5 = Move(Geometry=crv_19, Motion=Y_4)  # -> Geometry, Transform
area_2 = Area(Geometry=move_5.Geometry)  # -> Area, Centroid
ln_11 = Line(StartPoint=area.Centroid, EndPoint=area_2.Centroid)
move_6 = Move(Geometry=crv_20, Motion=Y_4)  # -> Geometry, Transform
move_7 = Move(Geometry=crv_21, Motion=Y_4)  # -> Geometry, Transform
move_8 = Move(Geometry=mirror_7.Geometry, Motion=ln_11)  # -> Geometry, Transform
swatch = ColourSwatch(SwatchColor=RGB(255, 0, 0))
swatch_2 = ColourSwatch(SwatchColor=RGB(217, 255, 0))
crv_23 = Curve(flatten([rectangle_3.Rectangle, crv_12, crv_10, crv_11, move_2.Geometry, move_3.Geometry, move_4.Geometry, move_6.Geometry]))
bake = ObjectBake(
    BakeToggle=bakebutton,
    GeometryObjects=[crv_15, crv_14, move.Geometry, move_5.Geometry, move_7.Geometry, move_8.Geometry],
    Layer="Cutout",
    ObjectName="GH_Obj",
    ObjectColor=swatch,
    LayerColor=swatch)
preview = CustomPreview(Geometry=[crv_15, crv_14, move.Geometry, move_5.Geometry, move_7.Geometry, move_8.Geometry], Shader=swatch)
bake_2 = ObjectBake(
    BakeToggle=bakebutton,
    GeometryObjects=crv_23,
    Layer="Folding Lines",
    ObjectName="GH_Obj",
    ObjectColor=swatch_2,
    LayerColor=swatch_2)
preview_2 = CustomPreview(
    Geometry=[rectangle_3.Rectangle, crv_12, crv_10, crv_11, move_2.Geometry, move_3.Geometry, move_4.Geometry, move_6.Geometry],
    Shader=swatch_2)
